# Grasshopper definition CourtyardShadingOptimization.gh (Grasshopper 1.0.7)
# plug-ins: Bifocals

number_slider = Slider(6, range=0..100)
number_slider_2 = Slider(20, range=0..100)
number_slider_3 = Slider(6, range=0..100)
ladybug = Ladybug_Ladybug()  # -> Vviiiiiiiiiizzz; plug-in component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
multiplication = Multiplication(A=number_slider_2, B=Slider(2, range=0..10))
multiplication_2 = Multiplication(A=number_slider_2, B=Slider(2, range=0..10))
sqgrid = Square(Plane=PlaneXY(0, 0, 0), Size=number_slider_2, ExtentX=number_slider, ExtentY=number_slider_3)  # -> flatten(Cells), Points
multiplication_3 = Multiplication(A=number_slider_2, B=number_slider_3)
multiplication_4 = Multiplication(A=number_slider_2, B=number_slider)
division = Division(A=multiplication, B="2")
division_2 = Division(A=multiplication_2, B="2")
area = Area(Geometry=sqgrid.Cells)  # -> Area, Centroid
rectangle = Rectangle(Plane=PlaneXY(0, 0, 0), XSize=multiplication_4, YSize=multiplication_3, Radius=0)  # -> Rectangle, Length
neg = Negative(Value=division_2)
neg_2 = Negative(Value=division)
dom = ConstructDomain(DomainStart=neg, DomainEnd=division_2)
dom_2 = ConstructDomain(DomainStart=neg_2, DomainEnd=division)
avr = Average(Input=area.Centroid)
rectangle_2 = Rectangle(Plane=avr, XSize=dom, YSize=dom_2, Radius=0)  # -> Rectangle, Length
incurve = PointInCurve(Point=area.Centroid, Curve=rectangle_2.Rectangle)  # -> Relationship, Point
equals = Equality(FirstNumber=incurve.Relationship, SecondNumber="0")  # -> Equality, Inequality
dispatch = Dispatch(List=sqgrid.Cells, DispatchPattern=equals.Equality)  # -> ListA, ListB
lng = ListLength(List=dispatch.ListA)
multiplication_5 = Multiplication(A=lng, B=Slider(0.4, range=0..1))
boundary = BoundarySurfaces(Edges=rectangle.Rectangle)
crv = Curve(dispatch.ListA)
int = Integer(multiplication_5)

number_slider_4 = Slider(80, range=0..100)

number_slider_5 = Slider(89, range=0..100)
gencumulativeskymtx = Ladybug_GenCumulativeSkyMtx(epwFile="Load epw file", skyDensity=0, useOldRes=True, runIt=Toggle(True))  # -> readMe, cumulativeSkyMtx; plug-in component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
dom_3 = ConstructDomain(DomainStart=Slider(34, range=0..100), DomainEnd=Slider(86, range=0..100))
random = Random(Range=dom_3, Number=int, Seed=number_slider_5)
reduce = RandomReduce(List=crv, Reduction=int, Seed=number_slider_4)
analysisperiod = Ladybug_AnalysisPeriod()  # -> readMe, analysisPeriod; plug-in component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
Z = UnitZ(Factor=random)
area_2 = Area(Geometry=reduce)  # -> Area, Centroid
scale = Scale(Geometry=reduce, Center=area_2.Centroid, Factor=Slider(0.9, range=0..1))  # -> Geometry, Transform
boundary_2 = BoundarySurfaces(Edges=scale.Geometry)
selectskymtx = Ladybug_selectSkyMtx(
    cumulativeSkyMtx=gencumulativeskymtx.cumulativeSkyMtx,
    analysisPeriod=analysisperiod.analysisPeriod,
    removeDiffuse=False,
    removeDirect=False)  # -> readMe, selectedSkyMtx; plug-in component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
extr = Extrude(Base=boundary_2, Direction=Z)
Y = UnitY(Factor=1)
radiationanalysis = Ladybug_RadiationAnalysis(
    north=Y,
    geometry=flatten(boundary),
    context=flatten(extr),
    gridSize=Slider(4, range=0..10),
    disFromBase=Slider(0.2, range=0..1),
    selectedSkyMtx=flatten(selectskymtx.selectedSkyMtx),
    runIt=Toggle(True))  # -> readMe, contextMesh, analysisMesh, testPts, testVec, port, radiationResult, radiationMesh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; plug-in component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
galapagos = Galapagos(fitness=radiationanalysis, gene=[number_slider_4, number_slider_5])
mesh = Mesh(radiationanalysis.radiationMesh)
mesh_2 = Mesh(radiationanalysis.radiationLegend)
